# Grasshopper definition ProjectionOfPoints.gh (Grasshopper 1.0.7)

srf = Surface(<surface referenced from the Rhino model>)
num = Number(100)
pop2d = Populate2D(Region=srf, Count=num, Seed=1)
facen = FaceNormals(Mesh=srf)  # -> Centers, Normals
srf_2 = Surface(<surface referenced from the Rhino model>)
project = ProjectPoint(Point=pop2d, Direction=facen.Normals, Geometry=srf_2)  # -> Point, Index
python = GhPythonScript(x=project.Point, y=project.Index)  # -> out, points, num_hits; inputs x: list, y: list
# ---------- python: Python ----------
data =  []
for i in range(len(x)):
    if y[i] == 0:
        data.append(x[i])
        
points = data
num_hits = len(points)
# ---------- end python ----------
panel = Panel(python.num_hits)
pt = Point(python.points)
