# Grasshopper definition View.gh (Grasshopper 1.0.7)

crv = Curve(<curve referenced from the Rhino model>)

# ---- group: Parallel
point = Point(Point(2.605503831, 3.861061283, 0))

# ----
crv_2 = Curve(<curve referenced from the Rhino model>)
boundary = BoundarySurfaces(Edges=crv)
boundary_2 = BoundarySurfaces(Edges=crv_2)
outside = Brep(<brep referenced from the Rhino model>)
parallel_rayshoot_example = GhPythonScript(startPnt=point, background=outside, fov=boundary, hood=boundary_2)  # -> out, pntsList; inputs startPnt: Point3d, background: Brep, fov: Brep, hood: Brep
# ---------- parallel_rayshoot_example: Python ----------
import rhinoscriptsyntax as rs
import time
import Rhino
import ghpythonlib.components as ghcomp
#from System.Collections.Generic import IEnumerable
#from System.Collections.Generic import List
import ghpythonlib.parallel
import copy
import math

hood = rs.coercebrep(hood)
fov = rs.coercebrep(fov)
pntsList = []

def check_rayCOM(p1,p2,geometry):
    #    Takes in two arguments
    #    each argument is an array of 3 points
    start_point = Rhino.Geometry.Point3d(float(p1[0]), float(p1[1]), float(p1[2]))
    direction = Rhino.Geometry.Vector3d(float(p2[0]), float(p2[1]), float(p2[2]))
    ray = Rhino.Geometry.Ray3d(start_point, direction)
    bounce = 1
    
    #geomBaseList = List[GeometryBase]()
    #points = [Rhino.Geometry.Point(pt) for pt in points]

    #intpt is the intersection of the geometry and the ray
    intPt = Rhino.Geometry.Intersect.Intersection.RayShoot(ray, [geometry], bounce)
    #intPt = Rhino.Geometry.Intersect.Intersection.RayShoot(ray, [geometry], bounce)
    
    if intPt == None:
        return None
    else:
        return intPt[0]

def check_rayCOMPAR(p1,p2,geometry,start_pnts):
    #    Takes in two arguments
    #    each argument is an array of 3 points
    
    direction = Rhino.Geometry.Vector3d(float(p2[0]), float(p2[1]), float(p2[2]))
    bounce = 1
    
    def par_Ray(start_point):
        ray = Rhino.Geometry.Ray3d(start_point, direction)
        intPt = Rhino.Geometry.Intersect.Intersection.RayShoot(ray, geometry, bounce)
        if intPt == None:
            return None
        else:
            return intPt[0]
    intPt = ghpythonlib.parallel.run(par_Ray,start_pnts,True)
    return intPt

def main():
    p1 = startPnt
    p2 = [0,0,-1]
    test_num = 100
    pnt_num = 500


        
    #return
    def rayshoot():
        #use rayshoot
        start_time = time.time()
        

        
        hoodBlocked = 0
        total = 0
        
        for z in range(-90,90):
            z = math.radians(z)
            #z = 0
            for i in range(0,360):
                x = math.sin(math.radians(i))
                y = math.cos(math.radians(i))
            
                direc = [x,y,z]
                total += 1 #add to the total rays shot
                res = check_rayCOM(p1,direc,fov)
                
                if res != None:
                    #print('hit')
                    pnt = ghcomp.ConstructPoint(x_coordinate = res[0], y_coordinate = res[1],z_coordinate = res[2])
                    pntsList.append(pnt)
                    res = check_rayCOM(p1,direc,hood)
                    
                    #if it hits the hood, it was blocked
                    if res != None: hoodBlocked += 1
            
        print("Time RayShoot:",time.time()-start_time)
        #print res
        
        return hoodBlocked,total
    
    def rayshootPAR():
        start_time = time.time()
        for i in range(0,test_num): res = check_rayCOMPAR(p1,p2,geometry,start_pnts)
        print("Time Parallel RayShoot:",time.time()-start_time)
        
    hoodBlocked, total = rayshoot()
    print("Percet That Hit Hood:",(hoodBlocked/total)*100)
    
    #rayshootPAR()

    return
    

main()
# ---------- end parallel_rayshoot_example ----------
