# Grasshopper definition Wagner_Divider_02.gh (Grasshopper 1.0.7)

md_slider = MDSlider(SliderMode=0, slider_value=Point(0, 0, 0.5), x_domain=Domain(0, 1), y_domain=Domain(0, 1), z_domain=Domain(0, 1))
md_slider_2 = MDSlider(
    SliderMode=0,
    slider_value=Point(0.5896792993, 1, 0.5),
    x_domain=Domain(0, 1),
    y_domain=Domain(0, 1),
    z_domain=Domain(0, 1))
md_slider_3 = MDSlider(SliderMode=0, slider_value=Point(1, 0, 0.5), x_domain=Domain(0, 1), y_domain=Domain(0, 1), z_domain=Domain(0, 1))
pt = Point(md_slider)
num = Number(Slider(0.275, range=0..1))
num_2 = Number(Slider(0.266, range=0..1))
pt_2 = Point(md_slider_2)
num_3 = Number(Slider(0.84, range=0..1))
num_4 = Number(Slider(0.28, range=0..1))
num_5 = Number(Slider(0.106, range=0..1))
num_6 = Number(Slider(0.727, range=0..1))
num_7 = Number(Slider(0.718, range=0..1))
num_8 = Number(Slider(0.723, range=0..1))
pt_3 = Point(md_slider_3)
pt_4 = ConstructPoint(XCoordinate=num_5, YCoordinate=num, ZCoordinate=0)
pt_5 = ConstructPoint(XCoordinate=num_2, YCoordinate=num_6, ZCoordinate=0)
pt_6 = ConstructPoint(XCoordinate=num_7, YCoordinate=num_8, ZCoordinate=0)
pt_7 = ConstructPoint(XCoordinate=num_3, YCoordinate=num_4, ZCoordinate=0)

intcrv_t = InterpolateT(Vertices=[pt, pt_2, pt_3], TangentStart=Vector(0, 0, 0), TangentEnd=Vector(0, 0, 0), KnotStyle=1)  # -> Curve, Length, Domain
int = Integer(Slider(6, range=0..6))
pln = Plane(PlaneYZ(0, 0, 0))
rotate = Rotate(Geometry=intcrv_t.Curve, Angle=1.570796327, Plane=pln)  # -> Geometry, Transform
rotax = RotateAxis(Geometry=rotate.Geometry, Angle=1.570796327, Axis=Line((0, 0, 0), (0, 0, 1)))  # -> Geometry, Transform
divide = DivideCurve(Curve=intcrv_t.Curve, Count=int, Kinks=False)  # -> Points, Tangents, Parameters
move = Move(Geometry=rotax.Geometry, Motion=Vector(0.4982010908, 0, 0))  # -> Geometry, Transform
move_2 = Move(Geometry=move.Geometry, Motion=Vector(0, -0.5456684349, 0))  # -> Geometry, Transform
divide_2 = DivideCurve(Curve=move_2.Geometry, Count=6, Kinks=False)  # -> Points, Tangents, Parameters
item = ListItem(List=divide_2.Points, Index=5, Wrap=True)
item_2 = ListItem(List=divide_2.Points, Index=4, Wrap=True)
item_3 = ListItem(List=divide_2.Points, Index=6, Wrap=True)
item_4 = ListItem(List=divide_2.Points, Index=3, Wrap=True)
intcrv_t_2 = InterpolateT(Vertices=[item_4, item_2, item, item_3], TangentStart=Vector(0, 0, 0), TangentEnd=Vector(0, 0, 0), KnotStyle=1)  # -> Curve, Length, Domain
swp2 = Sweep2(Rail1=rotate.Geometry, Rail2=intcrv_t.Curve, Sections=intcrv_t_2.Curve, SameHeight=False)
swp2_2 = Sweep2(Rail1=rotate.Geometry, Rail2=intcrv_t.Curve, Sections=intcrv_t_2.Curve, SameHeight=False)
join = BrepJoin(Breps=[swp2, swp2_2])  # -> Breps, Closed
item_5 = ListItem(List=divide.Points, Index=1, Wrap=True)
item_6 = ListItem(List=divide.Points, Index=5, Wrap=True)
item_7 = ListItem(List=divide.Points, Index=0, Wrap=True)
item_8 = ListItem(List=divide.Points, Index=4, Wrap=True)
item_9 = ListItem(List=divide.Points, Index=2, Wrap=True)
item_10 = ListItem(List=divide.Points, Index=3, Wrap=True)
item_11 = ListItem(List=divide.Points, Index=6, Wrap=True)
pt_8 = Point(divide.Points)  # disabled
vec = Vector(Vector(0.2453778141, 0, 0))
vec_2 = Vector(Vector(0.2453778141, 0, 0))
vec_3 = Vector(Vector(0.2453778141, 0, 0))
vec_4 = Vector(Vector(0.2453778141, 0, 0))
vec_5 = Vector(Vector(0.2453778141, 0, 0))
vec_6 = Vector(Vector(0.6117217802, 0.1145271804, 0))
vec_7 = Vector(Vector(-0.2928312225, 0, 0))
move_3 = Move(Geometry=item_11, Motion=vec_3)  # -> Geometry, Transform
move_4 = Move(Geometry=item_10, Motion=vec_2)  # -> Geometry, Transform
move_5 = Move(Geometry=item_9, Motion=vec_4)  # -> Geometry, Transform
move_6 = Move(Geometry=item_6, Motion=vec)  # -> Geometry, Transform
move_7 = Move(Geometry=item_8, Motion=vec_5)  # -> Geometry, Transform
move_8 = Move(Geometry=item_7, Motion=vec_6)  # -> Geometry, Transform
move_9 = Move(Geometry=item_7, Motion=vec_7)  # -> Geometry, Transform
vec_8 = VectorXYZ(XComponent=Slider(0.22, range=0..1), YComponent=Slider(0, range=0..1), ZComponent=Slider(0, range=0..1))  # -> Vector, Length
move_10 = Move(Geometry=item_5, Motion=vec_8.Vector)  # -> Geometry, Transform
swp2_3 = Sweep2(SameHeight=False)
intcrv_t_3 = InterpolateT(
    Vertices=[move_10.Geometry, move_8.Geometry, move_5.Geometry, move_4.Geometry, move_7.Geometry, move_6.Geometry, move_3.Geometry],
    TangentStart=Vector(0, 0, 0),
    TangentEnd=Vector(0, 0, 0),
    KnotStyle=1)  # -> Curve, Length, Domain
