# Grasshopper definition Wagner_dividerevolution_04.gh (Grasshopper 1.0.7)
# plug-ins: Octopus

number_slider = Slider(-0.2, range=-0.2..0.2)
number_slider_2 = Slider(0.19, range=-0.2..0.2)
number_slider_3 = Slider(-0.18, range=-0.2..0.2)
pt = Point(<point referenced from the Rhino model>)
pt_2 = Point(<point referenced from the Rhino model>)
pt_3 = Point(Point(0.1196914185, 0.06705389375, 1.321299658))
vec = VectorXYZ(XComponent=Slider(0, range=-0.2..0.2), YComponent=0, ZComponent=number_slider_2)  # -> Vector, Length
vec_2 = VectorXYZ(XComponent=number_slider, YComponent=0, ZComponent=number_slider_3)  # -> Vector, Length
pt_4 = Point(<point referenced from the Rhino model>)
pt_5 = Point(Point(0.9209430119, 0.1829591395, 1.190462702))
move = Move(Geometry=pt_3, Motion=vec.Vector)  # -> Geometry, Transform
move_2 = Move(Geometry=pt_5, Motion=vec_2.Vector)  # -> Geometry, Transform
intcrv = Interpolate(Vertices=[pt_4, move_2.Geometry, pt_2, move.Geometry, pt], Degree=3, Periodic=False, KnotStyle=1)  # -> Curve, Length, Domain
len = Length(Curve=intcrv.Curve)
octopus = Octopus(Phenotype=intcrv.Curve, OctopusData_obj=length, OctopusData_gene=[number_slider_2, number_slider, number_slider_3])
panel = Panel(octopus)
multiplication = Multiplication(A=len, B=-0.1)
length = Number(multiplication)
panel_2 = Panel(length)

srf = Surface(<surface referenced from the Rhino model>)
num = Number(100)
pop2d = Populate2D(Region=srf, Count=num, Seed=1)
facen = FaceNormals(Mesh=srf)  # -> Centers, Normals
srf_2 = Surface(<surface referenced from the Rhino model>)
project = ProjectPoint(Point=pop2d, Direction=facen.Normals, Geometry=srf_2)  # -> Point, Index
python = GhPythonScript(x=project.Point, y=project.Index)  # -> out, points, num_hits; inputs x: list, y: list
# ---------- python: Python ----------
data =  []
for i in range(len(x)):
    if y[i] == 0:
        data.append(x[i])
        
points = data
num_hits = len(points)
# ---------- end python ----------
panel_3 = Panel(python.num_hits)
pt_6 = Point(python.points)

# ----
# Shading Geometry
crv = Curve(<curve referenced from the Rhino model>)
crv_2 = Curve(<curve referenced from the Rhino model>)
crv_3 = Curve(<curve referenced from the Rhino model>)
crv_4 = Curve(<curve referenced from the Rhino model>)
merge = Merge(Data1=crv_3, Data2=crv_4, Data3=crv_2)  # -> flatten(Result)
crv_5 = Curve(<curve referenced from the Rhino model>)
swp2 = Sweep2(Rail1=crv_5, Rail2=intcrv.Curve, Sections=merge, SameHeight=False)
preview = CustomPreview(Geometry=swp2, Material=ColourSwatch(SwatchColor=RGB(125, 125, 125)))

divide = DivideCurve(Curve=crv, Count=4, Kinks=False)  # -> Points, Tangents, Parameters

# ----
# Geometry where you calculate light
crv_6 = Curve(<curve referenced from the Rhino model>)
crv_7 = Curve(<curve referenced from the Rhino model>)
loft = Loft(Curves=[crv_6, crv_7], Options={Adjust=False, Closed=False, LoftEnds=0, LoftSimp=0, LoftType=0, Rebuild=10, Refit=0.01})
flip = Flip(Surface=loft)  # -> Surface, Result
preview_2 = CustomPreview(Geometry=loft, Material=ColourSwatch(SwatchColor=RGB(184, 184, 184)))

# ---- group: Weather data/location
run = BooleanToggle(False)  # disabled
useold = BooleanToggle(True)
weath_file_data_path_epw = FilePath("C:\Users\caw25\Downloads\USA_NJ_Newark.725020_TMY2.epw")

# ---- group: analysis period
# Envirmental analysis period
# 6 months summer/
# 6 months winter
# summer solistice,
# winter solisitice
tohour = Slider(20, range=0..24)
fromday = Slider(22, range=1..31)
fromhour = Slider(5, range=0..24)
today = Slider(22, range=1..31)
tomonth = Slider(6, range=1..12)
frommonth = Slider(5, range=1..12)
analysisperiod = Ladybug_AnalysisPeriod(fromMonth=frommonth, fromDay=fromday, fromHour=fromhour, toMonth=tomonth, toDay=today, toHour=tohour)  # -> out, analysisPeriod; plug-in component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

# ---- group: RUN&BAKE ANALYSIS BELOW SRF
bake_analysis_below_shell = BooleanToggle(False)
run_analysis_below_shell = BooleanToggle(False)

# ---- group: Orientation_where is north?
Y = UnitY(Factor=1)
site_orientation = Vector(Y)

# ---- group: RUN&BAKE ANALYSIS ON SRF
bake_analysis_on_shell = BooleanToggle(False)
run_analysis_on_shell = BooleanToggle(False)

# ---- group: how dense and how high is our analysis
distance_from_base = Panel(".5")
grid_size = Panel(".01")

# ----
gencumulativeskymtx = Ladybug_GenCumulativeSkyMtx(epwFile=weath_file_data_path_epw, skyDensity=0, useOldRes=useold, runIt=run)  # -> readMe, cumulativeSkyMtx; plug-in component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

panel_4 = Panel("500")
legendpar = Ladybug_LegendParameters(highBound="500", numSegments=Slider(15, range=0..20))  # -> legendPar; plug-in component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

ladybug = Ladybug_Ladybug()  # -> Vviiiiiiiiiizzz; plug-in component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

# ---- group: set custom local folder to save analysis data
ladybug_2 = Ladybug_Ladybug()  # -> out; plug-in component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
panel_5 = Panel(ladybug)

# ----
selectskymtx = Ladybug_selectSkyMtx(
    cumulativeSkyMtx=gencumulativeskymtx.cumulativeSkyMtx,
    analysisPeriod=analysisperiod.analysisPeriod,
    removeDiffuse=False,
    removeDirect=False)  # -> readMe, selectedSkyMtx; plug-in component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

# ----
# Daylight Analysis_below surface
# right click and save the analysis data
# 01_ stream destination: file path to data folder in processing->ie: YYMMDD_radiationAnalysis_belowSRF_outPutA
# 02: right click and press :stream content (to save the actual content
radiationanalysis = Ladybug_RadiationAnalysis(
    north=site_orientation,
    geometry=flatten(flip.Surface),
    context=flatten(swp2),
    gridSize=grid_size,
    disFromBase=distance_from_base,
    selectedSkyMtx=flatten(selectskymtx.selectedSkyMtx),
    legendPar=flatten(legendpar),
    runIt=run_analysis_below_shell,
    bakeIt=bake_analysis_below_shell)  # -> out, contextMesh, analysisMesh, testPts, testVec, port, radiationResult, radiationMesh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; plug-in component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
panel_6 = Panel(radiationanalysis.testPts)
panel_7 = Panel(radiationanalysis.radiationResult)
concatenate = Concatenate(FragmentA=panel_6, FragmentB=panel_7)
panel_8 = Panel(concatenate)

sunpath = Ladybug_SunPath(
    north=site_orientation,
    hour=12,
    day=21,
    month=12,
    timeStep=1,
    analysisPeriod=analysisperiod.analysisPeriod,
    sunPathScale=Slider(0.327, range=0..1),
    dailyOrAnnualSunPath=True)  # -> readMe, sunVectors, sunAltitudes, sunAzimuths, port, sunSpheresMesh, sunPathCrvs, legend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; plug-in component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
